# Grasshopper definition HeatLossGain.gh (Grasshopper 0.9.76)
# plug-ins: Python Interpreter

# This example file is made 2017.09.20 21.42
panel = Panel("Calculating Heat Loss/Gain")
number_slider = Slider(0.236, range=0.1..1.1)
number_slider_2 = Slider(30, range=30..50)
number_slider_3 = Slider(32, range=0..35)
panel_2 = Panel("(W),(W/m2K),(m2),(K)")
panel_3 = Panel("Q = (U) (A) (∆T)")
panel_4 = Panel("Ventilation")
panel_5 = Panel("Infiltration")
panel_6 = Panel("Radiation")
panel_7 = Panel("Transmission")
expression = Expression(U=number_slider, A=number_slider_2, dT=number_slider_3, Expression="U*A*dt")
python = PythonScript(U=number_slider, A=number_slider_2, dt=number_slider_3)  # -> out, Q
# ---------- python: Python ----------
import math

fl = math.floor

Q = fl(U*A*dt)
# ---------- end python ----------
panel_8 = Panel(expression)
panel_9 = Panel(python.Q)
