# Grasshopper definition rhinoscriptsyntaxAndRhinocommon.gh (Grasshopper 0.9.76)
# plug-ins: Python Interpreter

ladybug = Ladybug_Ladybug()  # -> Vviiiiiiiiiizzz; plug-in component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
gismo = Gismo_Gismo(gismoFolder="c:\gismo")  # -> readMe; plug-in component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
crv = Curve([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])
crv_2 = Curve([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])
# "RhinoCommon (Rhino) og rhinoscriptsyntax"
# 
# 2017.10.04
# Kristoffer Negendahl
end = EndPoints(Curve=crv)  # -> Start, End
ln = Line(StartPoint=end.Start, EndPoint=end.End)

# ---- group: try me
line = Line(ln)
crv_3 = Curve(crv)
crv_4 = Curve(crv_2)

# ---- group: make some kind of geometry using rs an rc
python = PythonScript(ln=flatten(line), mult=Slider(0.34, range=0.01..1))  # -> brep, panels, mesh; inputs ln: list of Curve
# ---------- python: Python ----------
import Rhino.Geometry as rg
import rhinoscriptsyntax as rs

## create loft (GUID)
loft = rs.AddLoftSrf(ln)
## reparameterize loft

loft = rs.coercesurface(loft) # create a surface from GUID
intv = rg.Interval(0,1) # create interval
loft.SetDomain(0,intv) # reset domain U
loft.SetDomain(1,intv) # reset domain V

if not mult:
    mult = 1

u = int(loft.GetSurfaceSize()[1] * mult)
v = int(loft.GetSurfaceSize()[2] * mult)


panels = []
mesh=[]
for i in range(u):
    for j in range(v):
        pt11 = loft.PointAt(i/u, j/v)
        pt12 = loft.PointAt((i+1)/u, j/v)
        pt21 = loft.PointAt(i/u, (j+1)/v)
        pt22 = loft.PointAt((i+1)/u, (j+1)/v)
        panel = rg.NurbsSurface.CreateFromCorners(pt11, pt12, pt22, pt21)
        panels.append(panel)
        vertices = [pt11,pt12,pt21,pt22]
        meshface = meshface=rs.AddMesh(vertices,[(0,2,3,1)])
        mesh.append(meshface)

## join mesh elements
mesh = rs.JoinMeshes(mesh)
## create a brep from surface
brep = rg.Brep.CreateFromSurface(loft)
#mesh = rs.coercemesh(mesh)






"""
unset = rg.Point3d.Unset
ltype = rg.LoftType.Straight

nc = []
for l in ln:
    if rg.Line is type(l):
        print("Line converted")
        nc.append(rc.Geometry.NurbsCurve.CreateFromLine(l))

if len(nc) > 0:
    loft = rg.Brep.CreateFromLoft(nc,unset,unset,ltype,False)

else:
   loft = rg.Brep.CreateFromLoft(ln,unset,unset,ltype,False)

print(loft.getid)
"""
# ---------- end python ----------

# ----
mesh = Mesh(python.mesh)
